% Simulink data dictionary CATSS_FunctionalInterfaces.sldd

ConditionedAtmosphere = Simulink.Bus()
  O2Level: double
  CO2Level: double
  Temperature: double
  Pressure: double
  Humidity: double

PotableWater = Simulink.Bus()
  FlowRate: double
  Availability: double

WasteStream = Simulink.Bus()
  SolidWaste: double
  LiquidWaste: double

Consumables = Simulink.Bus()
  FoodSupply: double
  WaterSupply: double
  GeneralSupplies: double

ColonyHealthData = Simulink.Bus()
  VitalSigns: double
  ActivityLevel: double
  FeedingStatus: double

EnvironmentTelemetry = Simulink.Bus()
  AtmosphereStatus: double
  HabitatStatus: double
  ResourceLevels: double

ControlCommands = Simulink.Bus()
  OperatingMode: double
  ActuationSetpoints: double

SafetyState = Simulink.Bus()
  FaultAlerts: double
  SafeModeCommand: double
  EmergencyPowerStatus: double