% Simulink data dictionary CATSS_PhysicalInterfaces.sldd

CommandTelemetryIF = Simulink.Bus()
  CommandCode: double
  ModeState: double
  TelemetryValue: double

EnvironmentalControlIF = Simulink.Bus()
  AtmosphereQuality: double
  TemperatureMargin: double
  WaterAvailability: double

SafetyManagementIF = Simulink.Bus()
  FaultState: double
  EmergencyReserve: double
  SafeModeCommand: double

ConsumablesLogisticsIF = Simulink.Bus()
  FoodMass: double
  WaterMass: double
  SpareMass: double

WasteRecoveryIF = Simulink.Bus()
  WasteLoad: double
  RecoveryDemand: double
  WaterYield: double

HealthWelfareIF = Simulink.Bus()
  HealthIndex: double
  ActivityIndex: double
  IsolationState: double

DockingUtilityIF = Simulink.Bus()
  DockStatus: double
  UtilityTransfer: double
  GrowthCapacity: double