# Requirement set CATSS_SystemRequirements (R2025b)
CATSS System Requirements. Solution-neutral system-level requirements derived from the CATSS Stakeholder Needs. Bracketed [TBD]/[TBR] values mark open trades for the architecture team. Each requirement carries a Derive link to its source stakeholder need(s).

Attributes:
- Priority: Relative importance to mission success.
- VerificationMethod: Primary intended verification method.

## 1 [SEC-1] 1. Environmental Control & Life Support (ECLSS) (Container)

### 1.1 [SR-001] Cabin total pressure
The station shall maintain cabin total pressure of 101.3 kPa +/- 5% in occupied volumes.
Rationale: A stable sea-level-like pressure bounds physiological and hardware design and is a baseline habitability condition.
Priority: High
VerificationMethod: Test

### 1.2 [SR-002] Oxygen partial pressure
The station shall maintain oxygen partial pressure between 19.5 and 23.1 kPa in occupied volumes.
Rationale: Maintains adequate oxygenation for cats while bounding flammability risk.
Priority: High
VerificationMethod: Test

### 1.3 [SR-003] Carbon dioxide concentration
The station shall maintain carbon dioxide partial pressure below 0.4 kPa (24-hour average) in occupied volumes.
Rationale: Elevated CO2 impairs health and behavior; cats are continuous CO2 producers requiring active scrubbing.
Priority: High
VerificationMethod: Test

### 1.4 [SR-004] Cabin temperature
The station shall maintain cabin air temperature between 20 and 28 degC in occupied volumes [TBR].
Rationale: Cats tolerate a warmer comfort band than humans; range balances feline comfort against crew comfort and thermal cost.
Priority: High
VerificationMethod: Test

### 1.5 [SR-005] Relative humidity
The station shall maintain relative humidity between 30% and 70% in occupied volumes.
Rationale: Controls respiratory comfort, microbial growth, and static; bounds condensation in microgravity.
Priority: Medium
VerificationMethod: Test

### 1.6 [SR-006] Water recovery
The station shall recover and recycle at least 90% of cabin water by mass [TBR].
Rationale: Water mass dominates resupply; high recovery is the primary lever for cislunar autonomy and logistics cost.
Priority: High
VerificationMethod: Analysis

### 1.7 [SR-007] CO2 removal capacity
The station shall remove CO2 at the combined metabolic load of 50 cats plus up to [TBD] caretakers, with [TBD] margin.
Rationale: Scrubber sizing must envelope full occupancy plus caretaker presence with growth/contingency margin.
Priority: High
VerificationMethod: Analysis

### 1.8 [SR-008] Air particulate and dander control
The station shall filter airborne particulates, including dander and litter dust, to within [TBD] air-quality limits.
Rationale: Dander/litter dust accumulate in microgravity, threatening feline and crew respiratory health and equipment.
Priority: Medium
VerificationMethod: Test

### 1.9 [SR-009] Odor control
The station shall control cabin odor to within [TBD] limits.
Rationale: Odor is both a habitability and an early-indicator-of-fault concern in a closed cabin with many animals.
Priority: Medium
VerificationMethod: Demonstration

## 2 [SEC-2] 2. Habitat & Feline Welfare (Container)

### 2.1 [SR-010] Habitable volume per cat
The station shall provide at least 1.5 m^3 of habitable volume per cat [TBR].
Rationale: Sets a quantitative welfare/sizing floor that scales the habitat trade space.
Priority: High
VerificationMethod: Analysis

### 2.2 [SR-011] Three-dimensional territory
The station shall provide at least 1.0 m^2 of perch and climbing surface per cat, distributed in three dimensions [TBR].
Rationale: Microgravity makes the full volume usable; vertical/3D territory is essential to feline behavior and conflict reduction.
Priority: High
VerificationMethod: Analysis

### 2.3 [SR-012] Claw-compatible grip surfaces
The station shall provide claw-compatible textured surfaces for feline locomotion and stabilization throughout occupied volumes.
Rationale: Cats stabilize and translate using claws; without grippable surfaces they cannot locomote or self-stabilize in microgravity.
Priority: High
VerificationMethod: Demonstration

### 2.4 [SR-013] Scratching surfaces
The station shall provide dedicated scratching surfaces, at least 1 per 6 cats [TBR].
Rationale: Scratching is a maintenance and marking behavior; deprivation harms welfare and redirects damage onto hardware.
Priority: Medium
VerificationMethod: Inspection

### 2.5 [SR-014] Refuge spaces
The station shall provide enclosed refuge spaces, at least 1 per cat.
Rationale: Access to refuge is the primary feline coping mechanism for stress and conflict avoidance.
Priority: High
VerificationMethod: Inspection

### 2.6 [SR-015] Social-group partitioning
The station shall provide reconfigurable partitioning to segregate the colony into social groups of no more than 12 cats [TBR].
Rationale: Smaller stable groups reduce aggression and disease spread and enable quarantine/management flexibility.
Priority: High
VerificationMethod: Demonstration

### 2.7 [SR-016] Circadian lighting
The station shall provide programmable lighting with a 24-hour circadian cycle and adjustable photoperiod and intensity.
Rationale: A controlled light/dark cycle anchors feline circadian rhythm absent natural day/night in cislunar orbit.
Priority: Medium
VerificationMethod: Test

### 2.8 [SR-017] Acoustic noise limit
The station shall limit sustained acoustic noise in occupied volumes to no more than 60 dBA [TBR].
Rationale: Cats hear and stress to higher frequencies/levels than humans; noise is a chronic stressor in machinery-dense habitats.
Priority: Medium
VerificationMethod: Test

### 2.9 [SR-018] Behavioral enrichment
The station shall provide behavioral enrichment (e.g., interactive, foraging, or play stimuli) in each habitat zone.
Rationale: Enrichment mitigates boredom-driven stress and abnormal behavior over long-duration confinement.
Priority: Low
VerificationMethod: Demonstration

## 3 [SEC-3] 3. Food, Water & Waste (Container)

### 3.1 [SR-019] Food storage and dispensing
The station shall store and dispense food for 50 cats over the maximum resupply interval, plus 30% reserve.
Rationale: Food mass and shelf life size logistics and autonomy; reserve covers resupply slip and contingency.
Priority: High
VerificationMethod: Analysis

### 3.2 [SR-020] Potable water provision
The station shall provide potable water for 50 cats at no less than 200 mL/cat/day, plus [TBD] reserve.
Rationale: Bounds hydration supply and recycling demand; cats have low voluntary intake so availability must be assured.
Priority: High
VerificationMethod: Analysis

### 3.3 [SR-021] Feeding stations
The station shall provide microgravity-compatible feeding stations, at least 1 per 8 cats [TBR].
Rationale: Adequate, distributed feeding access reduces resource-guarding conflict and ensures all cats feed.
Priority: Medium
VerificationMethod: Inspection

### 3.4 [SR-022] Waste capture and containment
The station shall capture, contain, and process feline waste in microgravity with no uncontrolled release into the cabin.
Rationale: Free-floating waste is a hygiene, health, and equipment hazard unique to microgravity animal housing.
Priority: High
VerificationMethod: Test

### 3.5 [SR-023] Elimination stations
The station shall provide elimination stations, at least 1 per 4 cats [TBR].
Rationale: Sufficient, accessible elimination sites prevent inappropriate elimination and reduce stress/conflict.
Priority: Medium
VerificationMethod: Inspection

### 3.6 [SR-024] Resource recovery from waste
The station shall recover usable resources (e.g., water) from feline waste where practical to support closed-loop autonomy [TBD targets].
Rationale: Closing loops on waste reduces resupply mass and extends autonomy, directly serving cost and mission drivers.
Priority: Medium
VerificationMethod: Analysis

## 4 [SEC-4] 4. Health & Veterinary (Container)

### 4.1 [SR-025] Individual health monitoring
The station shall uniquely identify each cat and monitor individual health indicators: mass, activity, feeding, and body temperature.
Rationale: Per-individual monitoring enables early detection of illness in a large colony where group observation misses individuals.
Priority: High
VerificationMethod: Demonstration

### 4.2 [SR-026] Medical isolation capacity
The station shall provide medical isolation capacity for at least 10% of the colony simultaneously [TBR].
Rationale: Isolation is required to contain infectious disease and to recover sick/injured cats away from the group.
Priority: High
VerificationMethod: Inspection

### 4.3 [SR-027] Veterinary work area
The station shall provide a veterinary care area for examination and minor procedures.
Rationale: No rapid return-to-Earth exists in cislunar space; on-station veterinary capability is the only treatment path.
Priority: Medium
VerificationMethod: Demonstration

## 5 [SEC-5] 5. Operations & Autonomy (Container)

### 5.1 [SR-028] Autonomy duration
The station shall sustain the colony without resupply for at least 12 months (threshold), 18 months (objective).
Rationale: Defines the autonomy interval that sizes consumables, recycling, and logistics; the central mission-profile requirement.
Priority: High
VerificationMethod: Analysis

### 5.2 [SR-029] Consumables margin
The station shall retain at least 15% consumables margin at the end of each resupply interval [TBR].
Rationale: Margin protects against resupply slips and consumption uncertainty, preventing a welfare/safety cliff.
Priority: High
VerificationMethod: Analysis

### 5.3 [SR-030] Caretaking automation
The station shall automate routine feeding, watering, and waste servicing such that caretaker attention does not exceed [TBD] caretaker-hours per day.
Rationale: Caretaker labor is a primary recurring cost; an explicit workload cap forces automation in the architecture trade.
Priority: High
VerificationMethod: Demonstration

### 5.4 [SR-031] Fault detection and annunciation
The station shall autonomously detect, isolate, and annunciate faults in life-support-critical functions.
Rationale: Autonomous FDIR is required because cislunar latency/distance precludes timely ground intervention.
Priority: High
VerificationMethod: Test

### 5.5 [SR-032] Earth communications
The station shall support Earth communication tolerant of cislunar link availability and latency.
Rationale: Ground monitoring, vet tele-support, and operations all depend on a robust, latency-tolerant comm link.
Priority: Medium
VerificationMethod: Test

## 6 [SEC-6] 6. Safety & Survivability (Container)

### 6.1 [SR-033] Fault tolerance
The station shall be single-fault tolerant for any failure that could cause loss of the colony.
Rationale: One-fault tolerance for catastrophic outcomes is the baseline human-spaceflight safety posture, applied to the colony.
Priority: High
VerificationMethod: Analysis

### 6.2 [SR-034] Fire detection and suppression
The station shall detect and suppress fire in occupied and equipment volumes.
Rationale: Fire is a top catastrophic hazard in an oxygen-rich closed cabin; detection and suppression are mandatory.
Priority: High
VerificationMethod: Test

### 6.3 [SR-035] Safe haven
The station shall provide a safe-haven volume protecting all occupants for at least 24 hours during depressurization or contamination events [TBR].
Rationale: A protected refuge buys time for fault response or evacuation during the defining catastrophic events.
Priority: High
VerificationMethod: Analysis

### 6.4 [SR-036] Radiation protection
The station shall limit occupant radiation exposure to within [TBD] dose limits and provide sheltering against solar particle events.
Rationale: Cislunar radiation is a chronic and acute hazard; dose limits and SPE sheltering are required for long-duration occupancy.
Priority: High
VerificationMethod: Analysis

### 6.5 [SR-037] Emergency power
The station shall provide emergency power to life-support-critical loads for at least 24 hours after loss of primary power [TBR].
Rationale: Sustained critical-load power is required to survive a primary power failure long enough to recover or evacuate.
Priority: High
VerificationMethod: Test

## 7 [SEC-7] 7. Architecture, Cost & Interfaces (Container)

### 7.1 [SR-038] Modular growth
The station architecture shall allow habitat capacity to be added in increments of no more than 12 cats without redesigning existing modules.
Rationale: Bounded, redesign-free growth increments are the mechanism that makes scalability affordable and low-risk.
Priority: High
VerificationMethod: Analysis

### 7.2 [SR-039] Launch envelope conformance
Each launchable module shall fit within the mass and volume envelope of the reference launch-vehicle fairing ([TBD] kg, [TBD] m).
Rationale: Launch envelope is a hard architectural constraint and a primary cost driver per deployed module.
Priority: High
VerificationMethod: Analysis

### 7.3 [SR-040] Design-to-cost
The station shall meet design-to-cost targets of [TBD] for development and [TBD] recurring per module.
Rationale: An explicit cost target lets the team trade architectures against affordability rather than performance alone.
Priority: High
VerificationMethod: Analysis

### 7.4 [SR-041] Standardized interfaces
The station shall use standardized berthing, docking, and resupply interfaces common across modules and resupply vehicles.
Rationale: Interface commonality enables modular growth and cheaper, interchangeable resupply.
Priority: Medium
VerificationMethod: Inspection

### 7.5 [SR-042] Resupply cadence accommodation
The station shall accommodate resupply visits no more frequent than the autonomy interval in SR-028.
Rationale: Logistics planning and interfaces must align with the autonomy interval to keep recurring cost sustainable.
Priority: Medium
VerificationMethod: Analysis

## 8 [SEC-8] 8. Compliance (Container)

### 8.1 [SR-043] Human-spaceflight safety compliance
The station shall comply with applicable human-spaceflight safety standards for crewed elements, as tailored for this mission [TBD standard set].
Rationale: Crewed elements must meet recognized safety standards to obtain approval to fly and operate.
Priority: Medium
VerificationMethod: Inspection

### 8.2 [SR-044] Animal-welfare compliance
The station shall comply with applicable animal-welfare standards for housing and care of the colony, as tailored for spaceflight [TBD standard set].
Rationale: Welfare compliance codifies minimum acceptable care and is required for ethical and regulatory approval.
Priority: Medium
VerificationMethod: Inspection